# Grasshopper definition balloon+unordered_points.gh (Grasshopper 1.0.7)
# plug-ins: Weaverbird, Kangaroo2 Components

# ----
# Variable
cell_size = Slider(15, range=0..20)
threshold = Slider(8, range=0..10)
threshold_2 = Data(threshold)
cell_size_2 = Data(cell_size)

# ---- group: Building mesh
mesh = Mesh([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])

# ----
# Extreme points
wbjoin = WeaverbirdsJoinMeshesAndWeld(Mesh=mesh, Weld=False)
bbox = BoundingBox(Content=wbjoin, Plane=PlaneXY(0, 0, 0))  # -> Box, Box_2
debox = DeconstructBox(Box=bbox.Box)  # -> Plane, X, Y, Z
dedomain = DeconstructDomain(Domain=debox.X)  # -> Start, End
dedomain_2 = DeconstructDomain(Domain=debox.Y)  # -> Start, End
min_x = Number(dedomain.Start)
max_x = Number(dedomain.End)
min_y = Number(dedomain_2.Start)
max_y = Number(dedomain_2.End)

# ----
# Point Grid
min_x_2 = Number(min_x)
min_y_2 = Number(min_y)
max_x_2 = Number(max_x)
max_y_2 = Number(max_y)
cell_size_3 = Number(cell_size_2)
pt = ConstructPoint(XCoordinate=min_x_2, YCoordinate=min_y_2, ZCoordinate=0)
vec = VectorXYZ(XComponent=cell_size_3, YComponent=cell_size_3, ZComponent=0)  # -> Vector, Length
rev = Reverse(Vector=vec.Vector)
subtraction = Subtraction(A=max_x_2, B=min_x_2)
subtraction_2 = Subtraction(A=max_y_2, B=min_y_2)
move = Move(Geometry=pt, Motion=rev)  # -> Geometry, Transform
division = Division(A=subtraction, B=cell_size_3)
division_2 = Division(A=subtraction_2, B=cell_size_3)
round = Round(Number=division)  # -> Nearest, Floor, Ceiling
round_2 = Round(Number=division_2)  # -> Nearest, Floor, Ceiling
addition = Addition(A=round.Ceiling, B="2")
addition_2 = Addition(A=round_2.Ceiling, B="2")
sqgrid = Square(Plane=move.Geometry, Size=cell_size_3, ExtentX=addition, ExtentY=addition_2)  # -> Cells, Points
num = Number(addition)
num_2 = Number(addition_2)
point_grid = Point(flatten(sqgrid.Points))
item = TreeItem(Tree=simplify(sqgrid.Points), Path=graft(["0", num]), Index=["0", num_2], Wrap=True)
corners = Point(flatten(item))

# ----
# Cull points closer than threshold to walls
point_grid_2 = Point(point_grid)
pull = PullPoint(Point=point_grid_2, Geometry=simplify(mesh), ClosestOnly=True)  # -> ClosestPoint, Distance
flip = FlipMatrix(Data=pull.Distance)
sort = SortList(Keys=flip)  # -> Keys, ValuesA
item_2 = ListItem(List=sort.Keys, Index=0, Wrap=True)  # -> flatten(Item)
threshold_3 = Data(threshold_2)
larger = LargerThan(FirstNumber=item_2, SecondNumber=threshold_3)  # -> LargerThan, OrEqualTo
cull = CullPattern(List=point_grid_2, CullPattern=larger.LargerThan)
modified_point_grid = Point(cull)

# ----
# Initializes balloons
wbicosahedron = WeaverbirdsMeshMeshIcosahedron(Plane=modified_point_grid, Radius=expr("x*0.9", threshold_2))
wbloop = WeaverbirdsLoopSubdivision(MeshCurves=wbicosahedron, Level=2, SmoothNakedEdges=1)  # -> flatten(OutputMeshCurves)

# ----
# Balloons/balloons collisions
crossref = CrossReference(ListA=flatten(wbloop), ListB=flatten(wbloop), CrossMode=5)  # -> ListA, ListB
demesh = DeconstructMesh(Mesh=crossref.ListB)  # -> Vertices, Faces, Colours, Normals
spc = SolidPointCollide(Points=demesh.Vertices, Solid=graft(crossref.ListA), Interior=False, Unidirectional=False, Strength=1000)

# ----
# Balloon 'compression'
number_slider = Slider(7, range=1..15)
edgelengths = EdgeLengths(Mesh=wbloop, LengthFactor=Slider(2, range=0..4), Strength=number_slider)

# ----
# Balloons inflation pressure
number_slider_2 = Slider(1.27, range=0..2)
pressure = Pressure(M=wbloop, Strength=number_slider_2)

# ----
# Balloons/mesh collisions
demesh_2 = DeconstructMesh(Mesh=wbloop)  # -> Vertices, Faces, Colours, Normals
spc_2 = SolidPointCollide(Points=demesh_2.Vertices, Solid=wbjoin, Interior=True, Unidirectional=True, Strength=Slider(100, range=1..1000))

show = Show(G=wbloop)
# Run balloon simulation
button = Button()
entwine = Entwine(Branch00=[edgelengths, spc_2, pressure, spc], Branch01=show, FlattenInputs=True)  # disabled
bouncysolver = BouncySolver(
    GoalObjects=entwine,
    Reset=button,
    Threshold=1e-15,
    Tolerance=0.01,
    Damping=Slider(0.07, range=0.0001..1),
    Iterations=10,
    On=Toggle(False))  # -> I, V, O
mesh_2 = Mesh(bouncysolver.O)
wbloop_2 = WeaverbirdsLoopSubdivision(MeshCurves=mesh_2, Level=1, SmoothNakedEdges=1)
solver = Solver(GoalObjects=entwine, Reset=button, Threshold=1e-07, Tolerance=0.01, On=Toggle(False))  # -> I, V, O
colourful = Colourful(geo=wbloop_2)
bang = ExplodeTree(Data=solver.O)  # -> Branch0, Branch1

# ==== cluster Colourful: Display objects in bright colours
geo = ClusterInput()
geo_2 = Geometry(geo)
clean = CleanTree(RemoveNulls=True, RemoveInvalid=True, RemoveEmpty=False, Tree=flatten(geo_2))
S = Shader([{diffuse=RGB(11, 125, 222), emission=RGB(3, 38, 67), shine=0.5, specular=RGB(255, 255, 255), transparency=0}, {diffuse=RGB(222, 37, 11), emission=RGB(67, 11, 3), shine=0.5, specular=RGB(255, 255, 255), transparency=0}, {diffuse=RGB(71, 222, 11), emission=RGB(21, 67, 3), shine=0.5, specular=RGB(255, 255, 255), transparency=0}, {diffuse=RGB(222, 194, 11), emission=RGB(67, 58, 3), shine=0.5, specular=RGB(255, 255, 255), transparency=0}])
lng = ListLength(List=clean)
repeat = RepeatData(Data=S, Length=lng)
preview = CustomPreview(Geometry=clean, Shader=repeat)
