# Grasshopper definition gbXML_export.gh (Grasshopper 1.0.7)

panel = Panel("C:\Users\sdmei\git\space-invader\components\gbXML_export.py")
path = FilePath("C:\Users\sdmei\git\space-invader\components\gbXML_export.py")
brep = Brep([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])

# ----
# Room tags
area = Area(Geometry=brep)  # -> Area, Centroid
lng = ListLength(List=area.Centroid)
series = Series(Start=0, Step=1, Count=lng)
tag = TextTag(Location=area.Centroid, Text=series)

file = ReadFile(File=panel, PerLineParse=False)
connectivity = GhPythonScript(Code=file, Rooms=brep)
panel_2 = Panel(connectivity)
