# Grasshopper definition room_connectivity.gh (Grasshopper 1.0.7)

path = FilePath("C:\Users\sdmei\git\space-invader\room_connectivity.py")
srf = Surface(graft([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]))
file = ReadFile(File=path, PerLineParse=False)
python = GhPythonScript(Code=file, Srf=flatten(srf), Move_dist=Slider(1000, range=0..1000), Pt_dist=Slider(1000, range=200..5000))  # -> Out, All_pts, All_sgmts
crv = Curve(python.All_sgmts)
pt = Point(python.All_pts)
